# Dynamo graph EnergyAnalysisForDynamo_ex1b_CreateEnergyModelAndSetSurfaceParams.dyn (Dynamo 0.7.2.2114)

# note: 1. Select Mass element from Revit/Vasari document
select_model_element = DSModelElementSelection()  # 1 picked in the model
levels = Levels(index=0)
# note: 2. Create Analysis Zones From Mass and Levels
createEnergyModelFromMassAndLevels = EnergyAnalysisForDynamo.PrepareEnergyModel.CreateEnergyModelFromMassAndLevels(select_model_element, levels)
# note: 3. Draw Surfaces
drawAnalysisSurface = EnergyAnalysisForDynamo.PrepareEnergyModel.DrawAnalysisSurface(createEnergyModelFromMassAndLevels.out2)
surface_index = IntegerSlider(3, range=0..10)
getItemAtIndex = List.GetItemAtIndex(createEnergyModelFromMassAndLevels.out2, surface_index)
glazing = DoubleSlider(0.6, range=0.2..0.8)
shading_depth = DoubleSlider(1, range=0..1.5)
sill_height = DoubleSlider(1, range=0..2)
conceptual_construction_types = ConcConstTypeDropdown(index=0)  # "Conceptual Construction Types Dropdown"
# note: 4. Customize parameters for the surface of interest
setWallSurfaceParameters = EnergyAnalysisForDynamo.PrepareEnergyModel.SetWallSurfaceParameters(getItemAtIndex, glazing, shading_depth, sill_height, conceptual_construction_types)
# note: 4. Highlight the modified surface
getItemAtIndex_2 = List.GetItemAtIndex(drawAnalysisSurface, setWallSurfaceParameters)
