# Dynamo graph EnergyAnalysisForDynamo_ex1c_CreateEnergyModelAndSetZoneParams.dyn (Dynamo 0.8.0.950)

# note: 1. Select Mass from Revit/Vasari document
select_model_element = DSModelElementSelection()  # 1 picked in the model
levels = Levels("Level 1")
# note: 2. This node prepares the energy model and outputs zoneIds and surfaceIds.
# Model setting will be inherited from Revits's EnergySetting. You can customize the setting for any zone or surface using SetSurfaceParameters and SetZoneParameters nodes.
createByMassLevels = EnergyAnalysisForDynamo.PrepareEnergyModel.CreateByMassLevels(select_model_element, levels)
integer_slider = IntegerSlider(3, range=0..10 step 1)
getItemAtIndex = List.GetItemAtIndex(list=createByMassLevels.out1, index=integer_slider)
decomposeZone = EnergyAnalysisForDynamo.PrepareEnergyModel.DecomposeZone(getItemAtIndex)
drawAnalysisSurface = EnergyAnalysisForDynamo.PrepareEnergyModel.DrawAnalysisSurface(decomposeZone)
space_types_dropdown = SpaceTypeDropdown("ActiveStorage")
condition_types_dropdown = ConditionType("HeatedAndCooled")
# note: 4. Modify Zone Parameter
setZoneParameters = EnergyAnalysisForDynamo.PrepareEnergyModel.SetZoneParameters(getItemAtIndex, space_types_dropdown, condition_types_dropdown)
# note: 3. Draw Zones, Highlight selected zone, and decompose zone example
drawAnalysisZone = EnergyAnalysisForDynamo.PrepareEnergyModel.DrawAnalysisZone(getItemAtIndex)
