# Dynamo graph EnergyAnalysisForDynamo_ex1d_iterativeAnalysisExample.dyn (Dynamo 0.7.2.2114)

iterativeGlazing = Custom[IterativeGlazing]()  # Example of a custom parametric run
# note: 1. Select Mass element from Revit/Vasari document
select_model_element = DSModelElementSelection()  # 1 picked in the model
levels = Levels(index=0)
# note: 2. Create Analysis Zones From Mass and Levels
createEnergyModelFromMassAndLevels = EnergyAnalysisForDynamo.PrepareEnergyModel.CreateEnergyModelFromMassAndLevels(select_model_element, levels)
code_block = CodeBlock { 0.1..0.9..0.05; }
count = Count(code_block)
ofRepeatedItem = List.OfRepeatedItem(createEnergyModelFromMassAndLevels.out2, count)
file_path = Filename("C:\Users\bh\Desktop\cmon.xml")
watch = Watch(file_path)
fromObject = String.FromObject(watch)
code_block_2 = CodeBlock { ".xml"; }
code_block_3 = CodeBlock { ""; }
replace = String.Replace(fromObject, code_block_2, code_block_3)
fromObject_2 = String.FromObject(code_block)
code_block_4 = CodeBlock { "."; }
code_block_5 = CodeBlock { ""; }
replace_2 = String.Replace(fromObject_2, code_block_4, code_block_5)
concat = Python(IN[0]=replace, IN[1]=replace_2)  # "Py.Concat"
# ---------- concat.python (16 lines) ----------
import clr
clr.AddReference('ProtoGeometry')
from Autodesk.DesignScript.Geometry import *
#The inputs to this node will be stored as a list in the IN variable.
dataEnteringNode = IN

outstrs = []

path = IN[0]
iter = IN[1]

for i in iter:
	outstrs.Add(str(path)+i+".xml")

#Assign your output to the OUT variable
OUT = outstrs
# ----------------------------------------
count_2 = Count(code_block)
ofRepeatedItem_2 = List.OfRepeatedItem(createEnergyModelFromMassAndLevels.out0, count_2)
laceLongest = List.LaceLongest(iterativeGlazing, ofRepeatedItem, code_block, concat, ofRepeatedItem_2)
watch_2 = Watch(laceLongest)
