# Dynamo graph GBSforDynamo_ex1b_CreateEnergyModelAndSetSurfaceParams.dyn (Dynamo 0.7.2.3911)

select_model_element = DSModelElementSelection()  # 1 picked in the model
levels = Levels(index=0)
createFromMassAndLevels = GBSforDynamo.AnalysisZones.CreateFromMassAndLevels(select_model_element, levels)
surface_index = IntegerSlider(6, range=0..10)
getItemAtIndex = List.GetItemAtIndex(createFromMassAndLevels.out2, surface_index)
glazing = DoubleSlider(0.7, range=0.2..0.8)
shading_depth = DoubleSlider(3, range=0.2..3)
sill_height = DoubleSlider(0.3859533163, range=0..5)
setSurfaceParameters = GBSforDynamo.AnalysisZones.SetSurfaceParameters(getItemAtIndex, glazing, shading_depth, sill_height)
drawAnalysisSurface = GBSforDynamo.AnalysisZones.DrawAnalysisSurface(createFromMassAndLevels.out2)
getItemAtIndex_2 = List.GetItemAtIndex(drawAnalysisSurface, surface_index)
conceptual_construction_types = ConcConstTypeDropdown(index=0)  # "Conceptual Construction Types Dropdown"
