# Dynamo graph GBSforDynamo_ex1c_CreateEnergyModelAndSetZoneParams.dyn (Dynamo 0.7.2.3911)

select_model_element = DSModelElementSelection()  # 1 picked in the model
levels = Levels(index=0)
createFromMassAndLevels = GBSforDynamo.AnalysisZones.CreateFromMassAndLevels(select_model_element, levels)
surface_index = IntegerSlider(3, range=0..10)
getItemAtIndex = List.GetItemAtIndex(createFromMassAndLevels.out1, surface_index)
decomposeMassZone = GBSforDynamo.AnalysisZones.DecomposeMassZone(getItemAtIndex)
drawAnalysisSurface = GBSforDynamo.AnalysisZones.DrawAnalysisSurface(decomposeMassZone)
space_types_dropdown = SpaceTypeDropdown(index=95)
condition_types_dropdown = ConditionType(index=2)
setZoneParameters = GBSforDynamo.AnalysisZones.SetZoneParameters(getItemAtIndex, space_types_dropdown, condition_types_dropdown)
