# Dynamo graph GBSforDynamo_ex3b_CreategbXMLfromZones.dyn (Dynamo 0.7.1.10102)

file_path = Filename("C:\Users\EErtugrul\Desktop\gbXMLcompilerfromZones")
select_model_element = DSModelElementSelection()  # 1 picked in the model
createFromMass = GBSforDynamo.AnalysisZones.CreateFromMass(select_model_element)
boolean = BoolSelector(true)
gbXMLCompiler_fromZones = GBSforDynamo.GBSConnection.gbXMLCompiler_fromZones(file_path, createFromMass.out1, boolean)
